# Dynamo graph graph_construction_part1.dyn "graph_construction_1" (Dynamo 2.10.1.3976)
# packages: MEPover 2022.1.1, Clockwork for Dynamo 2.x 2.4.0, MeshToolkit 3.0.0

# group: Part 1: customized abstract elements, Site and Levels (not find buildings)
required_bim_elements = StringInput("Site - Internal Origin")
required_bim_elements_2 = StringInput("Levels")
list_create = List.Create(item0=required_bim_elements, item1=required_bim_elements_2)
byName = Category.ByName(name=list_create)
all_elements_of_category = ElementsOfCategory(Category=byName)

# group: Parameters for level and site
watch = Watch(all_elements_of_category)
flatten = List.Flatten(list=watch)
uniqueId = Element.UniqueId(element=flatten)
process_uniqueid = Python(IN[0]=uniqueId)  # CPython3
# ---------- process_uniqueid.python (21 lines) ----------
# Load the Python Standard and DesignScript Libraries
import sys
import clr
clr.AddReference('ProtoGeometry')
from Autodesk.DesignScript.Geometry import *

 
# The inputs to this node will be stored as a list in the IN variables.
dataEnteringNode = IN # parameter returns a list 

uniqeid_ls = [] # create a dictionary for storing all parameters

for each in IN[0]:
    
    temp_dic = {}
    
    temp_dic['UniqueId'] = each
    
    uniqeid_ls.append(temp_dic)
 
OUT = uniqeid_ls
# ----------------------------------------
watch_2 = Watch(process_uniqueid)
id = Element.Id(element=flatten)
process_id = Python(IN[0]=id)  # CPython3
# ---------- process_id.python (26 lines) ----------
# Load the Python Standard and DesignScript Libraries
import sys
import clr
clr.AddReference('ProtoGeometry')
from Autodesk.DesignScript.Geometry import *

# The inputs to this node will be stored as a list in the IN variables.
dataEnteringNode = IN # parameter returns a list 

id_ls = [] # create a dictionary for storing all parameters

for each in IN[0]:
    
    temp_dic = {}
    
    temp_dic['Id'] = each
    
    id_ls.append(temp_dic)
    

#id_dic['Id'] = IN[0]

#id_dic['UniqueId'] = IN[1]

OUT=id_ls
# OUT = each
# ----------------------------------------
watch_3 = Watch(process_id)
parameters = Element.Parameters(element=flatten)
process_parameters = Python(IN[0]=parameters)  # CPython3
# ---------- process_parameters.python (41 lines) ----------
# Load the Python Standard and DesignScript Libraries
import sys
import clr
clr.AddReference('ProtoGeometry')
from Autodesk.DesignScript.Geometry import *


# The inputs to this node will be stored as a list in the IN variables.
dataEnteringNode = IN # parameter returns a list 

#para_dic = {} 
parameters_ls = []

for j in IN[0]:
    
    para_dic = {} # create a dictionary for storing all parameters
        
    for i in j:
        #ls.append(i)

        ls = str(i).split(":")
        
        # make sure
        if ls[1] != " ":
        
            if len(ls)>1:
            
                para_dic[ls[0]] = ls[1]
            else:
                pass #para_dic[ls[0]] = "None"
            
        
    parameters_ls.append(para_dic)
        
    
    
#name, value = str(IN[0][0]).split(":")
#para_dic  = {name:value}   
 
# Assign your output to the OUT variable.
OUT = parameters_ls  #name, value # para_dic #str(IN[0][0]).split(":")
# ----------------------------------------
watch_4 = Watch(process_parameters)
put_all_parameters_together = Python(IN[0]=watch_2, IN[1]=watch_3, IN[2]=watch_4)  # CPython3
# ---------- put_all_parameters_together.python (44 lines) ----------
# Load the Python Standard and DesignScript Libraries
import sys
import clr
clr.AddReference('ProtoGeometry')
from Autodesk.DesignScript.Geometry import *


sys.path.append(r"C:\Users\Zijian Wang\.conda\envs\dynamo\Lib\site-packages")

import ctypes  # An included library with Python install.  

# The inputs to this node will be stored as a list in the IN variables.
dataEnteringNode = IN

# Place your code below this line
uniqeid_ls =  IN[0]
id_ls = IN[1]
parameters_ls = IN[2]


all_ele_para = [] # create a dictionary for storing all parameters for all elements


 
# judge whether the same lenght
if len(uniqeid_ls) == len(id_ls)  == len(parameters_ls):
    
    # merge
    for i in range(len(uniqeid_ls)):
    
        
        each_ele_para = {**uniqeid_ls[i], **id_ls[i], **parameters_ls[i]}
    
        all_ele_para.append(each_ele_para)

    OUT = all_ele_para
    
else:
    OUT = "WRONG! NOT SAME LENGTH"
    ctypes.windll.user32.MessageBoxW(0, "Problem: attribute length cannot match, file not save", "Wraming", 1)

    

# Assign your output to the OUT variable.
# ----------------------------------------
watch_5 = Watch(put_all_parameters_together)

# group: Part 2: retrieve all other model elements:
all_categories_in_document = Custom[All categories in document]()  # package MEPover; Retrieves all categories from the current document and splits them up in Model, Annotation, Analytic and Internal Categories
all_elements_of_category_2 = ElementsOfCategory(Category=all_categories_in_document.Model_categories)
isNotEmpty = Custom[List.IsNotEmpty](seq=all_elements_of_category_2@L2)  # package Clockwork for Dynamo 2.x; Just the inversion of the built-in Is Empty List node.
filterByBoolMask = List.FilterByBoolMask(list=all_elements_of_category_2, mask=isNotEmpty)

# group: Parameters for BIM elements
watch_6 = Watch(filterByBoolMask.in)
flatten_2 = List.Flatten(list=watch_6)
watch_7 = Watch(flatten_2)
uniqueId_2 = Element.UniqueId(element=watch_7)
process_uniqueid_2 = Python(IN[0]=uniqueId_2)  # CPython3
# ---------- process_uniqueid_2.python (21 lines) ----------
# Load the Python Standard and DesignScript Libraries
import sys
import clr
clr.AddReference('ProtoGeometry')
from Autodesk.DesignScript.Geometry import *


# The inputs to this node will be stored as a list in the IN variables.
dataEnteringNode = IN # parameter returns a list 

uniqeid_ls = [] # create a dictionary for storing all parameters

for each in IN[0]:
    
    temp_dic = {}
    
    temp_dic['UniqueId'] = each
    
    uniqeid_ls.append(temp_dic)
 
OUT = uniqeid_ls
# ----------------------------------------
watch_8 = Watch(process_uniqueid_2)
id_2 = Element.Id(element=watch_7)
process_id_2 = Python(IN[0]=id_2)  # CPython3
# ---------- process_id_2.python (27 lines) ----------
# Load the Python Standard and DesignScript Libraries
import sys
import clr
clr.AddReference('ProtoGeometry')
from Autodesk.DesignScript.Geometry import *


# The inputs to this node will be stored as a list in the IN variables.
dataEnteringNode = IN # parameter returns a list 

id_ls = [] # create a dictionary for storing all parameters

for each in IN[0]:
    
    temp_dic = {}
    
    temp_dic['Id'] = each
    
    id_ls.append(temp_dic)
    

#id_dic['Id'] = IN[0]

#id_dic['UniqueId'] = IN[1]

OUT=id_ls
# OUT = each
# ----------------------------------------
watch_9 = Watch(process_id_2)
parameters_2 = Element.Parameters(element=watch_7)
process_parameters_2 = Python(IN[0]=parameters_2)  # CPython3
# ---------- process_parameters_2.python (42 lines) ----------
# Load the Python Standard and DesignScript Libraries
import sys
import clr
clr.AddReference('ProtoGeometry')
from Autodesk.DesignScript.Geometry import *

# load extral libraries 

# The inputs to this node will be stored as a list in the IN variables.
dataEnteringNode = IN # parameter returns a list 

#para_dic = {} 
parameters_ls = []

for j in IN[0]:
    
    para_dic = {} # create a dictionary for storing all parameters
        
    for i in j:
        #ls.append(i)

        ls = str(i).split(":")
        
        # make sure
        if ls[1] != " ":
        
            if len(ls)>1:
            
                para_dic[ls[0]] = ls[1]
            else:
                pass #para_dic[ls[0]] = "None"
            
        
    parameters_ls.append(para_dic)
        
    
    
#name, value = str(IN[0][0]).split(":")
#para_dic  = {name:value}   
 
# Assign your output to the OUT variable.
OUT = parameters_ls  #name, value # para_dic #str(IN[0][0]).split(":")
# ----------------------------------------
watch_10 = Watch(process_parameters_2)
getLocation = Element.GetLocation(element=watch_7)
process_locations = Python(IN[0]=getLocation)  # CPython3
# ---------- process_locations.python (70 lines) ----------
# Load the Python Standard and DesignScript Libraries
import sys
import clr
clr.AddReference('ProtoGeometry')
from Autodesk.DesignScript.Geometry import *

# load extral libraries 
sys.path.append(r"C:\Users\Zijian Wang\.conda\envs\dynamo\Lib\site-packages")

import ctypes  
# The inputs to this node will be stored as a list in the IN variables.
dataEnteringNode = IN # parameter returns a list 

loc_ls = [] # create a list for storing locations



for each in IN[0]:

    
    loc_temp = {}
    
    if str(each) == 'None':
        
        loc_ls.append(loc_temp) # add none if the place is empty
        
    elif str(type(each)) == "<class 'Autodesk.DesignScript.Geometry.Point'>":
        

        loc_temp['point'] = [each.X, each.Y, each.Z]
        loc_ls.append(loc_temp)
        
    elif str(type(each)) == "<class 'Autodesk.DesignScript.Geometry.Line'>":
        
        sp = each.StartPoint # get the start point by using its default function
        loc_temp['startpoint'] = [sp.X, sp.Y, sp.Z]
        
        ep = each.EndPoint # get the end point by using its default function
        loc_temp['endpoint'] = [ep.X, ep.Y, ep.Z]
        
        dir = each.Direction
        loc_temp['direction'] = [dir.X, dir.Y, dir.Z]
        
        loc_temp['length'] = each.Length
        
        loc_ls.append(loc_temp)
    
    
    elif str(type(each)) == "<class 'Autodesk.DesignScript.Geometry.Arc'>": 
        
        nm = each.Normal
        loc_temp['Normal'] = [nm.X, nm.Y, nm.Z, nm.Length]
        
        cp = each.CenterPoint
        loc_temp['CenterPoint'] = [cp.X, cp.Y, cp.Z]
        
        loc_temp['Radius'] = [each.Radius]
        
        loc_temp['StartAngle'] = [each.StartAngle]
        
        loc_temp['SweepAngle'] = [each.SweepAngle]
        
        loc_ls.append(loc_temp)
        
    
    
    else:
        ctypes.windll.user32.MessageBoxW(0, "Unknown data type in Process Locations function ", "Warming", 1)
  
OUT = loc_ls
# ----------------------------------------
watch_11 = Watch(process_locations)
put_all_parameters_together_2 = Python(IN[0]=watch_8, IN[1]=watch_9, IN[2]=watch_10, IN[3]=watch_11)  # CPython3
# ---------- put_all_parameters_together_2.python (44 lines) ----------
# Load the Python Standard and DesignScript Libraries
import sys
import clr
clr.AddReference('ProtoGeometry')
from Autodesk.DesignScript.Geometry import *


sys.path.append(r"C:\Users\Zijian Wang\.conda\envs\dynamo\Lib\site-packages")

import ctypes  # An included library with Python install.  

# The inputs to this node will be stored as a list in the IN variables.
dataEnteringNode = IN

# Place your code below this line
uniqeid_ls =  IN[0]
id_ls = IN[1]
parameters_ls = IN[2]
loc_ls = IN[3]

all_ele_para = [] # create a dictionary for storing all parameters for all elements


 
# judge whether the same lenght
if len(uniqeid_ls) == len(id_ls)  == len(parameters_ls) == len(loc_ls): # == len(bbx_ls)
    
    # merge
    for i in range(len(uniqeid_ls)):
    
        
        each_ele_para = {**uniqeid_ls[i], **id_ls[i], **parameters_ls[i], **loc_ls[i]} #**bbx_ls[i], 
    
        all_ele_para.append(each_ele_para)

    OUT = all_ele_para
    
else:
    OUT = "WRONG! NOT SAME LENGTH"
    ctypes.windll.user32.MessageBoxW(0, "Problem: attribute length cannot match, file not save", "Wraming", 1)

    

# Assign your output to the OUT variable.
# ----------------------------------------

create_attribute_dictionary = Python(IN[0]=watch_5, IN[1]=put_all_parameters_together_2)  # CPython3
# ---------- create_attribute_dictionary.python (14 lines) ----------
# Load the Python Standard and DesignScript Libraries
import sys
import clr
clr.AddReference('ProtoGeometry')
from Autodesk.DesignScript.Geometry import *


# The inputs to this node will be stored as a list in the IN variables.
dataEnteringNode = IN


all_ele_para  =IN[0] + IN[1] 
# dictionary of storing parameters for all elements
OUT = all_ele_para
# ----------------------------------------
directory_path = Directory("C:\Users\Zijian Wang\OneDrive - Technion\Desktop\Universal SE\Selected Revit models\Apt raw from dynamo")

# group: Exact geometry for BIM elements
geometry = Element.Geometry(element=watch_7)

delete_non_solid_geometry = Python(IN[0]=geometry)  # CPython3
# ---------- delete_non_solid_geometry.python (21 lines) ----------
# Load the Python Standard and DesignScript Libraries
import sys
import clr
clr.AddReference('ProtoGeometry')
from Autodesk.DesignScript.Geometry import *

# The inputs to this node will be stored as a list in the IN variables.
dataEnteringNode = IN

ele_list = IN[0]

OUT = []
for each in ele_list:

    temp = []
    
    for i in each:
        if str(i) == "Solid": 
            temp.append(i)
            
    OUT.append(temp)
# ----------------------------------------

# group (continued): Exact geometry for BIM elements
byUnion = Solid.ByUnion(solids=delete_non_solid_geometry@L2)

byGeometry = Autodesk.Dynamo.MeshToolkit.Mesh.ByGeometry(inputGeometry=byUnion@L1)

# group (continued): Exact geometry for BIM elements
create_exactgeometry_file_name = Python(IN[0]=directory_path, IN[1]=process_uniqueid_2, IN[2]=byGeometry)  # CPython3
# ---------- create_exactgeometry_file_name.python (47 lines) ----------
# Load the Python Standard and DesignScript Libraries
import sys
import clr
clr.AddReference('ProtoGeometry')
from Autodesk.DesignScript.Geometry import *
import csv

# load extral libraries 
sys.path.append(r"C:\Users\Zijian Wang\.conda\envs\dynamo\Lib\site-packages")
import os 
import ctypes  
# The inputs to this node will be stored as a list in the IN variables.
dataEnteringNode = IN # parameter returns a list

#IN[0] is the para_dic
#IN[1] is the loc_dic

dir_path = IN[0]

uniqeid_ls = IN[1]

mesh_ls = IN[2]

ply_path_list = []


if len(uniqeid_ls) == len(mesh_ls):

    for i in range(len(uniqeid_ls)):
    
        if str(mesh_ls[i]) == 'None':
        
            filepath = os.sep.join([dir_path, "exactgeometry", "empty.ply"])
            ply_path_list.append(filepath)
            
        else:
            
            uniqueid = uniqeid_ls[i]['UniqueId']
            filepath = os.sep.join([dir_path, "exactgeometry", str(uniqueid)+".ply"])
            ply_path_list.append(filepath)

else: 
    ctypes.windll.user32.MessageBoxW(0, "Not same length for exact geometry", "Warming", 1)



OUT = ply_path_list
# ----------------------------------------
watch_12 = Watch(create_exactgeometry_file_name)

exportMeshes = Autodesk.Dynamo.MeshToolkit.Mesh.ExportMeshes(filename=watch_12@L1, meshes=byGeometry@L1)

# group: For initialization, it create the temp_attribute, and send all exact geometry. For tracking change, it compare the file with the previous one, and find out changed parts save as a csv, and send the csv and modified exact geometry to the server.
create_sendfile_list = Python(IN[0]=create_attribute_dictionary, IN[1]=exportMeshes, IN[2]=directory_path)  # CPython3
# ---------- create_sendfile_list.python (254 lines) ----------
# Load the Python Standard and DesignScript Libraries
import sys
import clr
clr.AddReference('ProtoGeometry')
from Autodesk.DesignScript.Geometry import *

sys.path.append(r"C:\Users\Zijian Wang\.conda\envs\dynamo\Lib\site-packages")
import os 
import shutil
import time
import csv
import ctypes  

########## the following function is used for comparing 
def readcsv(csv_path):
# this function is to read csv files back to a list containing element attributes dictionary

    with open(csv_path) as csv_file:
        csv_reader = csv.reader(csv_file, delimiter=',')
        dict_list = []

        att_dict_temp = {}

        for row in csv_reader:

            if str(row) == "['==========']":
                # append an element's attribute to the list when it is not empty
                if att_dict_temp:
                    dict_list.append(att_dict_temp)
                # reset as empty for the next attribute
                att_dict_temp = {}

            else:
                key = row[0].strip().replace(" ", "") #move heading, tailing, between spaces

                if len(row) >= 1  and  len(row) <=3:
                    
                    value = row[1].strip().replace(" ", "") 

                elif len(row) >3 :
                    
                    value = row[1].split("[")[-1] + "," +  row[2] + "," + row[3].split("]")[0]  

                else:
                    value = ""

                att_dict_temp[key]=value #put it as an element in the dictionary

    return dict_list

def uniqueIdList(att_list):
    list_id = []

    for each in att_list:
        if each['UniqueId']:
            list_id.append(each['UniqueId'])
        else:
            print("Wrong! This element has no UniqueId")

    return list_id

def dict_compare(d1, d2):
    d1_keys = set(d1.keys())
    d2_keys = set(d2.keys())
    shared_keys = d1_keys.intersection(d2_keys)
    added = d1_keys - d2_keys
    removed = d2_keys - d1_keys
    modified = {o : (d1[o], d2[o]) for o in shared_keys if d1[o] != d2[o]}
    same = set(o for o in shared_keys if d1[o] == d2[o])
    return added, removed, modified, same

def list_compare(list_new, list_old, list_old_id):

    ls_added_obj = []
    ls_del_obj = []
    ls_com_obj = []
    ls_change = []
    ls_change_id = []

    # each is a dictionary contains a new BIM object's all attributes 
    for each in list_new:

        element_id = each['UniqueId']

        # try to find out all changed parameters
        if element_id in list_old_id:
            
            # find the place of the id in id_list, come back to attribute list and return the attribute
            # each_old is a attribute dictionary containing an old BIM object's all attributes
            each_old = list_old[list_old_id.index(element_id)] 

            added, removed, modified, same= dict_compare(each, each_old)

            # print(modified)

            # removed is a dictionary
            if modified:
                modified['UniqueId'] = element_id
                ls_change.append(modified)

                ls_change_id.append(element_id)
            
            # if added:
            #     # TD 
            #     ls_change.append(added)
                
            # if removed:
            #     # TD  
            #     ls_change.append(removed)
        
            # record the list, the BIM element exist in both lists
            ls_com_obj.append(element_id)

        else:
            ls_added_obj.append(each) # if element is not in previous, it is an added element

    print(ls_com_obj)
    # delete existing elements, based on ls_com_obj stored in previous


    ls_del_obj = list_old_id

    for each in ls_com_obj:

        ls_del_obj.remove(each)
 

    return ls_added_obj, ls_del_obj, ls_change, ls_change_id



####################  Input ##############################
# The inputs to this node will be stored as a list in the IN variables.
dataEnteringNode = IN

all_ele_para = IN[0]
eg_list = IN[1]
original_file_path = IN[2]

send_list = []


temp_file_path = os.path.join(original_file_path, "attribute_temp.csv")


##### when there are no files, it means that the model is not initialized yet.
#### we are trying to save all parameters, and all exact geometry
if not os.path.exists(temp_file_path):
    
    # create this file and write the attribute dictionary into the file
    with open(temp_file_path, 'w') as f:
        f.write("==========\n") # add seperators bewteen elements    
        # here is to write all parameters of one element
        for each in all_ele_para:
            for key in each.keys():
                f.write("%s, %s\n" % (key, each[key]))    
            f.write("==========\n") # add seperators bewteen elements
        f.close()
    
    # create the name of the file with date
    timestr = time.strftime("%Y%m%d_%H%M%S") # time stamp
    backup_file_path = os.path.join(IN[2], timestr+".csv")
    # copy the temp file to the data file for backup
    shutil.copy(temp_file_path, backup_file_path) 
    
    send_list.append(temp_file_path)
    
    # append each exact geometry to the list
    for each in eg_list:
        if str(each) != "None":
            send_list.append(each)
            

    # for test, we use send_list
    # OUT = send_list
    
##### when there exsit files, it means that the model has been initialized
#### we only save changed paramters and their corresponding exact geometry 
else:
    
    ## read the old attribute
    old_all_ele_para = readcsv(temp_file_path)
    
    ## write the new attributes to csv
    timestr = time.strftime("%Y%m%d_%H%M%S") # time stamp
    new_file_path = os.path.join(IN[2], timestr+".csv")
    # create this file and write the attribute dictionary into the file
    with open(new_file_path, 'w') as f:
        f.write("==========\n") # add seperators bewteen elements    
        # here is to write all parameters of one element
        for each in all_ele_para:
            for key in each.keys():
                f.write("%s, %s\n" % (key, each[key]))    
            f.write("==========\n") # add seperators bewteen elements
        f.close()
    # copy the file and rename as temp
    shutil.copy(new_file_path, temp_file_path) 
    
    ## read the new attribute
    new_all_ele_para = readcsv(new_file_path)


    ## find out the difference between the two dictionary
    list_old_id = uniqueIdList(old_all_ele_para)
    
    ls_added_obj, ls_del_obj, list_change, list_change_id = list_compare(new_all_ele_para, old_all_ele_para, list_old_id)
    
    ## save the modified parameter as a new csv  file: 
    if list_change:
        mod_path = os.path.join(original_file_path, "modification.csv")
        with open(mod_path , 'w') as f:
            f.write("==========\n") # add seperators bewteen elements    
            # here is to write all parameters of one element
            for each in list_change:
                for key in each.keys():
                    f.write("%s, %s\n" % (key, each[key]))    
                f.write("==========\n") # add seperators bewteen elements
            f.close()
        send_list.append(mod_path)

    ## save the addition as a new csv  file: 
    if ls_added_obj:
        add_path = os.path.join(original_file_path, "addition.csv")
        with open(add_path , 'w') as f:
            f.write("==========\n") # add seperators bewteen elements    
            # here is to write all parameters of one element
            for each in ls_added_obj:
                for key in each.keys():
                    f.write("%s, %s\n" % (key, each[key]))    
                f.write("==========\n") # add seperators bewteen elements
            f.close()
        send_list.append(add_path)

    ## save the deletion as a new csv file: 
    if ls_del_obj:
        del_path = os.path.join(original_file_path, "deletion.csv")
        with open(del_path , 'w') as f:
            for each in ls_del_obj:
                f.write(each) 
                f.write("\n")
            f.close()
        send_list.append(del_path)

    


    
    for i in list_change_id:
        
        temp = os.path.join(original_file_path, "exactgeometry/"+i+".ply")
        
        send_list.append(temp)
 
OUT = send_list
# ----------------------------------------
watch_13 = Watch(create_sendfile_list)

code_block = CodeBlock {  }
